# Grasshopper definition fractal_tree_00.gh (Grasshopper 1.0.4)

radius_to_length_proportion = Slider(11, range=0..100)
radius_to_length_proportion_2 = Slider(11, range=0..100)
length_randomness = Slider(58, range=0..100)
angle_randomness = Slider(59, range=0..100)
length_randomness_2 = Slider(63, range=0..100)
construct_point = ConstructPoint(XCoordinate=0, YCoordinate=0, ZCoordinate=0)
angle_randomness_2 = Slider(49, range=0..100)
length_randomness_3 = Slider(72, range=0..100)
construct_point_2 = ConstructPoint(XCoordinate=0, YCoordinate=0, ZCoordinate=0)
angle_randomness_3 = Slider(49, range=0..100)
construct_point_3 = ConstructPoint(XCoordinate=0, YCoordinate=0, ZCoordinate=0)
length_change = Slider(0.7, range=-0.1..0.9)
starting_length = Slider(241, range=50..1000)
depth = Slider(6, range=1..15)
max_angle = Slider(36, range=5..90)
length_change_2 = Slider(0.7, range=-0.1..0.9)
depth_2 = Slider(6, range=1..15)
max_angle_2 = Slider(44, range=5..90)
starting_length_2 = Slider(243, range=50..1000)
max_angle_3 = Slider(54, range=0..180)
length_change_3 = Slider(0.7, range=-0.1..0.9)
depth_3 = Slider(8, range=1..15)
starting_length_3 = Slider(243, range=50..1000)
max_angle_4 = Slider(44, range=5..90)
max_angle_5 = Slider(42, range=0..180)
starting_ngon = Slider(8, range=1..15)
ghpython_script = GhPythonScript(
    anchorp=construct_point_3,
    depth=depth,
    angle=max_angle,
    length=starting_length,
    lvariation=length_change,
    aran=angle_randomness,
    lran=length_randomness)  # -> treelin, treept; inputs anchorp: Point3d
# ---------- ghpython_script: Python ----------
#importing grasshopper python modules
import rhinoscriptsyntax as rs
import Rhino.Geometry as rg

#importing generic modules
from math import cos
from math import sin
from math import radians
import random

#Inputs
#anchorp - point3D, anchor point
#depth - integer, recursion cnt
#angle - float, split base angle
#length - float, first branch length
#lvariation - float, length change with each branch
#aran - float, % of randomness in relation to base angle
#lran - float, % of randomness in relation to base length

#getting starting point from anchorpoint
x1 = anchorp.X
y1 = anchorp.Y
z1 = anchorp.Z

#setting base variables
x2 = x1
y2 = y1
z2 = z1

#base angle
anglerec = 0

#list of lines that form the tree, this is the output variable 
treelin = []


#recursive function
def fractal(depth , x2, y2, z2, length, anglerec, angle, lvariation, aran, lran):
    
    #test if depth>0
    if depth:
        
        #defining random angle variation and length variation
        arn = random.uniform(-angle/100*aran, angle/100*aran)
        lrn = random.uniform(-length/100*lran, length/100*lran)
        
        #defining points
        x1 = x2
        y1 = y2
        z1 = z2 
        z2 = z1 + (length+lrn)*cos(radians(anglerec))
        y2 = y1 + (length+lrn)*sin(radians(anglerec))
        
        #changing branch length dependant on branch depth
        length = length*lvariation
        
        #building points
        stpoint = [x1, y1, z1]
        endpoint = [x2, y2, z2]
        
        #building line between points
        treelin.append(rs.AddLine(stpoint, endpoint))
        
        #calling function with different angle parameter for branch splitting
        fractal(depth - 1 , x2, y2, z2, length, (anglerec+angle+arn), angle, lvariation, aran, lran)
        fractal(depth - 1 , x2, y2, z2, length, (anglerec-angle+arn), angle, lvariation, aran, lran)
        
#first recursive function call
fractal(depth, x2, y2, z2, length, anglerec, angle, lvariation, aran, lran)
# ---------- end ghpython_script ----------
ghpython_script_2 = GhPythonScript(
    anchorp=construct_point,
    depth=depth_2,
    angle=max_angle_2,
    angleh=max_angle_3,
    length=starting_length_2,
    lvariation=length_change_2,
    aran=angle_randomness_2,
    lran=length_randomness_2,
    radtolen=radius_to_length_proportion)  # -> out, flatlinep; inputs anchorp: Point3d
# ---------- ghpython_script_2: Python ----------
#importing grasshopper python modules
import rhinoscriptsyntax as rs
import Rhino.Geometry as rg
import ghpythonlib.parallel as ghp
import ghpythonlib.components as ghc
import Rhino as rc


#importing generic modules
from math import cos
from math import sin
from math import radians
import random

#Inputs
#anchorp - point3D, anchor point
#depth - integer, recursion cnt
#angle - float, split base angle
#length - float, first branch length
#lvariation - float, length change with each branch
#aran - float, % of randomness in relation to base angle
#lran - float, % of randomness in relation to base length
#radtolen - proportion between starting length branch depth and branch radius

#getting starting point from anchorpoint
x1 = anchorp.X
y1 = anchorp.Y
z1 = anchorp.Z

#setting base variables
x2 = x1
y2 = y1
z2 = z1

#base angle
anglerec = 0
anglerech = 0

#list of lines that form the tree, this is the output variable 
treelin = {}

anglest = []

#recursive function
def fractal(depth, x2, y2, z2, length, anglerec, angle, lvariation, aran, lran, anglerech, angleh):
    
    #test if depth>0
    if depth:
        
        #defining random angle variation and length variation
        arn = random.uniform(-angle/100*aran, angle/100*aran)
        lrn = random.uniform(-length/100*lran, length/100*lran)
        
        #defining horizontal rotation angles
        ahor = random.sample(range(0,360), 4)
        
        #removing numbers within tolerance
        ahr = rs.CullDuplicateNumbers(ahor, angleh)
        
        #in a 360 fashion
        if ahr[0]+360-angleh<ahr[-1]:
            del ahr[0]
        
        #defining points
        x1 = x2
        y1 = y2
        z1 = z2 
        x2 = x1 - (length+lrn)*sin(radians(anglerec))*sin(radians(anglerech))
        y2 = y1 + (length+lrn)*sin(radians(anglerec))*cos(radians(anglerech))
        z2 = z1 + (length+lrn)*cos(radians(anglerec))
        
        #changing branch length dependant on branch depth
        length = length*lvariation
        
        #building points
        stpoint = rg.Point3d(x1, y1, z1)
        endpoint = rg.Point3d(x2, y2, z2)
        
        #building line between points
        linegeo = rg.Line(stpoint, endpoint)
        
        #building a dict of lines with depth as key, and corresponding lines as values
        if depth not in treelin.keys():
            treelin[depth] = [linegeo]
        else: 
            treelin[depth].append(linegeo)
        
        #calling function with different angle parameter for branch splitting
        #calling as many branches as spread within tolerance
        if len(ahr) > 0:
            fractal(depth - 1 , x2, y2, z2, length, (anglerec+angle+arn), angle, lvariation, aran, lran, ahr[0], angleh)
        if len(ahr) > 1:
            fractal(depth - 1 , x2, y2, z2, length, (anglerec-angle+arn), angle, lvariation, aran, lran, ahr[1], angleh)
        if len(ahr) > 2:
            fractal(depth - 1 , x2, y2, z2, length, (anglerec+angle+arn), angle, lvariation, aran, lran, ahr[2], angleh)
        if len(ahr) > 3:
            fractal(depth - 1 , x2, y2, z2, length, (anglerec-angle+arn), angle, lvariation, aran, lran, ahr[3], angleh)
        
#first recursive function call
fractal(depth, x2, y2, z2, length, anglerec, angle, lvariation, aran, lran, anglerech, angleh)

#sort dict of branch lines
treelinsorted = {}
branch = depth

for key in treelin.keys():
    treelinsorted[branch] = treelin[key]
    branch -= 1

#maybe implement intersect tests between branches
def removeintersections():
    pass
    #events = Rhino.Geometry.Intersect.Intersection.CurveCurve(curveA, curveB, intersection_tolerance, overlap_tolerance)

#function that create sphere capped pipes on lines
def pipes(args):
    crv, rad = args
    return ghc.Pipe(crv, rad, 1)

#paralle compute execution of pipes function
linep = []

for kk in treelinsorted.keys():
    args = [[treelinsorted[kk], (length*(lvariation**kk))/radtolen]]
    linep.append(ghp.run(pipes, args, True))

#flatten a list of pipes for output
flatlinep = [y for x in linep for y in x]
# ---------- end ghpython_script_2 ----------
ghpython_script_3 = GhPythonScript(
    anchorp=construct_point_2,
    depth=depth_3,
    angle=max_angle_4,
    angleh=max_angle_5,
    length=starting_length_3,
    lvariation=length_change_3,
    aran=angle_randomness_3,
    lran=length_randomness_3,
    radtolen=radius_to_length_proportion_2,
    mngon=starting_ngon)  # -> out, flatlinep, stpnt, endpnt, vect, pln, pgons, joined; inputs anchorp: Point3d
# ---------- ghpython_script_3: Python ----------
#importing grasshopper python modules
import rhinoscriptsyntax as rs
import Rhino.Geometry as rg
import ghpythonlib.parallel as ghp
import ghpythonlib.components as ghc
import Rhino as rc


#importing generic modules
from math import cos
from math import sin
from math import radians
import random

#Inputs
#anchorp - point3D, anchor point
#depth - integer, recursion cnt
#angle - float, split base angle
#length - float, first branch length
#lvariation - float, length change with each branch
#aran - float, % of randomness in relation to base angle
#lran - float, % of randomness in relation to base length
#radtolen - proportion between starting length branch depth and branch radius

#getting starting point from anchorpoint
x1 = anchorp.X
y1 = anchorp.Y
z1 = anchorp.Z

#setting base variables
x2 = x1
y2 = y1
z2 = z1

#base angle
anglerec = 0
anglerech = 0

#list of lines that form the tree, this is the output variable 
treelin = {}

anglest = []

#recursive function
def fractal(depth, x2, y2, z2, length, anglerec, angle, lvariation, aran, lran, anglerech, angleh):
    
    #test if depth>0
    if depth:
        
        #defining random angle variation and length variation
        arn = random.uniform(-angle/100*aran, angle/100*aran)
        lrn = random.uniform(-length/100*lran, length/100*lran)
        
        #defining horizontal rotation angles
        ahor = random.sample(range(0,360), 4)
        
        #removing numbers within tolerance
        ahr = rs.CullDuplicateNumbers(ahor, angleh)
        
        #in a 360 fashion
        if ahr[0]+360-angleh<ahr[-1]:
            del ahr[0]
        
        #defining points
        x1 = x2
        y1 = y2
        z1 = z2 
        x2 = x1 - (length+lrn)*sin(radians(anglerec))*sin(radians(anglerech))
        y2 = y1 + (length+lrn)*sin(radians(anglerec))*cos(radians(anglerech))
        z2 = z1 + (length+lrn)*cos(radians(anglerec))
        
        #changing branch length dependant on branch depth
        length = length*lvariation
        
        #building points
        stpoint = rg.Point3d(x1, y1, z1)
        endpoint = rg.Point3d(x2, y2, z2)
        
        #building line between points
        linegeo = rg.Line(stpoint, endpoint)
        
        #building a dict of lines with depth as key, and corresponding lines as values
        if depth not in treelin.keys():
            treelin[depth] = [linegeo]
        else: 
            treelin[depth].append(linegeo)
        
        #calling function with different angle parameter for branch splitting
        #calling as many branches as spread within tolerance
        if len(ahr) > 0:
            fractal(depth - 1 , x2, y2, z2, length, (anglerec+angle+arn), angle, lvariation, aran, lran, ahr[0], angleh)
        if len(ahr) > 1:
            fractal(depth - 1 , x2, y2, z2, length, (anglerec-angle+arn), angle, lvariation, aran, lran, ahr[1], angleh)
        if len(ahr) > 2:
            fractal(depth - 1 , x2, y2, z2, length, (anglerec+angle+arn), angle, lvariation, aran, lran, ahr[2], angleh)
        if len(ahr) > 3:
            fractal(depth - 1 , x2, y2, z2, length, (anglerec-angle+arn), angle, lvariation, aran, lran, ahr[3], angleh)
        
#first recursive function call
fractal(depth, x2, y2, z2, length, anglerec, angle, lvariation, aran, lran, anglerech, angleh)

#sort dict of branch lines
treelinsorted = {}
branch = depth

for key in treelin.keys():
    treelinsorted[branch] = treelin[key]
    branch -= 1

#maybe implement intersect tests between branches
def removeintersections():
    pass
    #events = Rhino.Geometry.Intersect.Intersection.CurveCurve(curveA, curveB, intersection_tolerance, overlap_tolerance)

#output list
pgons = []

#create ngon branch depth dependant
def ngons(args):
    nn, length, lvariation, kk, radtolen, mngon, depth = args
    stpnt = ghc.EndPoints(nn)[0] #returns list of two points, start and end
    endpnt = ghc.EndPoints(nn)[1]
    vect = ghc.Vector2Pt(stpnt, endpnt, False)[0] #returns list with vector and vector length
    pln = ghc.PlaneNormal(stpnt, vect) #returns a plane perp to a vector
    radius = length*(lvariation**kk)/radtolen
        
    #reduce details with each branch, but not less than 3
    if mngon-kk+1 <= 3:
        splits = 3
    else:
        splits = mngon-kk+1
    
    pgn = ghc.Polygon(pln, radius, splits, 0)[0] #returns a polygon and its perimeter
    
    if kk == depth:
        geo = ghc.ExtrudePoint(pgn, endpnt) #if last branch than make a pyramid
    else:
        geo = ghc.Extrude(pgn, vect) #extrudes the polygon along vector
    
    return ghc.CapHoles(geo) #caps ends on the extruded brep

#iterate over branches and run ngons func
for kk in treelinsorted.keys():
    for nn in treelinsorted[kk]:
        args = [nn, length, lvariation, kk, radtolen, mngon, depth]
        pgons.append(ngons(args))

def joiner(breps):
    return ghc.SolidUnion(breps)

#joined = joiner(pgons)
# ---------- end ghpython_script_3 ----------
extrude_point = ExtrudePoint()
panel = Panel(ghpython_script_3.out)
construct_mesh = ConstructMesh(Vertices=[Point(0, 0, 0), Point(10, 0, 0), Point(10, 10, 0), Point(0, 10, 0)], Faces={A=0, B=1, C=2, D=3})
