# Grasshopper definition fractal_tree_01.gh (Grasshopper 1.0.4)
# plug-ins: Weaverbird

unit_z = UnitZ(Factor=1)
max_horizontal_branches = Slider(4, range=1..6)
radius_to_length_proportion = Slider(5, range=0..100)
depth = Slider(3, range=1..15)
length_randomness = Slider(0, range=0..100)
angle_randomness = Slider(0, range=0..100)
max_horizontal_branches_2 = Slider(4, range=1..6)
radius_to_length_proportion_2 = Slider(5, range=0..100)
max_horizontal_branches_3 = Slider(4, range=1..6)
radius_to_length_proportion_3 = Slider(10, range=0..100)
verticality = Slider(0, range=0..85)
thicknress_change = Slider(0.6, range=-0.1..0.9)
construct_point = ConstructPoint(XCoordinate=0, YCoordinate=0, ZCoordinate=0)
construct_point_2 = ConstructPoint(XCoordinate=0, YCoordinate=0, ZCoordinate=0)
depth_2 = Slider(5, range=1..15)
length_change = Slider(0.9, range=-0.1..0.9)
starting_length = Slider(500, range=50..1000)
max_angle = Slider(35, range=5..90)
max_angle_2 = Slider(65, range=0..180)
growth_chance = Slider(28, range=0..100)
length_randomness_2 = Slider(0, range=0..100)
length_randomness_3 = Slider(0, range=0..100)
angle_randomness_2 = Slider(0, range=0..100)
angle_randomness_3 = Slider(0, range=0..100)
starting_ngon = Slider(12, range=1..15)
verticality_2 = Slider(0, range=0..85)
verticality_3 = Slider(15.01, range=0..85)
thicknress_change_2 = Slider(0.6, range=-0.1..0.9)
thicknress_change_3 = Slider(0.8, range=-0.1..1)
radius_to_length_proportion_4 = Slider(11, range=0..100)
radius_to_length_proportion_5 = Slider(11, range=0..100)
max_horizontal_branches_4 = Slider(4, range=1..6)
length_change_2 = Slider(0.9, range=-0.1..0.9)
length_change_3 = Slider(0.8, range=-0.1..1)
starting_length_2 = Slider(500, range=50..1000)
starting_length_3 = Slider(500, range=50..1000)
length_randomness_4 = Slider(58, range=0..100)
depth_3 = Slider(5, range=1..15)
max_angle_3 = Slider(35, range=5..90)
max_angle_4 = Slider(35, range=5..90)
max_angle_5 = Slider(65, range=0..180)
max_angle_6 = Slider(28, range=0..180)
angle_randomness_4 = Slider(59, range=0..100)
length_randomness_5 = Slider(63, range=0..100)
length_randomness_6 = Slider(72, range=0..100)
radius_to_length_proportion_6 = Slider(20, range=0..100)
growth_chance_2 = Slider(100, range=0..100)
growth_chance_3 = Slider(100, range=0..100)
construct_point_3 = ConstructPoint(XCoordinate=0, YCoordinate=0, ZCoordinate=0)
angle_randomness_5 = Slider(49, range=0..100)
construct_point_4 = ConstructPoint(XCoordinate=0, YCoordinate=0, ZCoordinate=0)
angle_randomness_6 = Slider(49, range=0..100)
starting_ngon_2 = Slider(8, range=1..15)
starting_ngon_3 = Slider(8, range=1..15)
construct_point_5 = ConstructPoint(XCoordinate=0, YCoordinate=0, ZCoordinate=0)
length_randomness_7 = Slider(0, range=0..100)
construct_point_6 = ConstructPoint(XCoordinate=0, YCoordinate=0, ZCoordinate=0)
angle_randomness_7 = Slider(0, range=0..100)
length_change_4 = Slider(0.7, range=-0.1..0.9)
starting_length_4 = Slider(241, range=50..1000)
depth_4 = Slider(6, range=1..15)
max_angle_7 = Slider(36, range=5..90)
length_change_5 = Slider(0.7, range=-0.1..0.9)
depth_5 = Slider(5, range=1..15)
starting_length_5 = Slider(243, range=50..1000)
starting_length_6 = Slider(243, range=50..1000)
length_change_6 = Slider(0.7, range=-0.1..0.9)
max_angle_8 = Slider(44, range=5..90)
max_angle_9 = Slider(54, range=0..180)
depth_6 = Slider(5, range=1..15)
max_angle_10 = Slider(44, range=5..90)
max_angle_11 = Slider(42, range=0..180)
length_change_7 = Slider(0.8, range=-0.1..0.9)
starting_length_7 = Slider(570, range=50..1000)
max_angle_12 = Slider(56, range=5..90)
construct_point_7 = ConstructPoint(XCoordinate=0, YCoordinate=0, ZCoordinate=0)
starting_ngon_4 = Slider(8, range=1..15)
max_angle_13 = Slider(0, range=0..180)
move = Move(Motion=Vector(0, 0, 10))  # -> Geometry, Transform
starting_ngon_5 = Slider(7, range=1..15)
ghpython_script = GhPythonScript(
    anchorp=construct_point_6,
    depth=depth_4,
    angle=max_angle_7,
    length=starting_length_4,
    lvariation=length_change_4,
    aran=angle_randomness_4,
    lran=length_randomness_4)  # -> treelin, treept; inputs anchorp: Point3d
# ---------- ghpython_script: Python ----------
#importing grasshopper python modules
import rhinoscriptsyntax as rs
import Rhino.Geometry as rg

#importing generic modules
from math import cos
from math import sin
from math import radians
import random

#Inputs
#anchorp - point3D, anchor point
#depth - integer, recursion cnt
#angle - float, split base angle
#length - float, first branch length
#lvariation - float, length change with each branch
#aran - float, % of randomness in relation to base angle
#lran - float, % of randomness in relation to base length

#getting starting point from anchorpoint
x1 = anchorp.X
y1 = anchorp.Y
z1 = anchorp.Z

#setting base variables
x2 = x1
y2 = y1
z2 = z1

#base angle
anglerec = 0

#list of lines that form the tree, this is the output variable 
treelin = []


#recursive function
def fractal(depth , x2, y2, z2, length, anglerec, angle, lvariation, aran, lran):
    
    #test if depth>0
    if depth:
        
        #defining random angle variation and length variation
        arn = random.uniform(-angle/100*aran, angle/100*aran)
        lrn = random.uniform(-length/100*lran, length/100*lran)
        
        #defining points
        x1 = x2
        y1 = y2
        z1 = z2 
        z2 = z1 + (length+lrn)*cos(radians(anglerec))
        y2 = y1 + (length+lrn)*sin(radians(anglerec))
        
        #changing branch length dependant on branch depth
        length = length*lvariation
        
        #building points
        stpoint = [x1, y1, z1]
        endpoint = [x2, y2, z2]
        
        #building line between points
        treelin.append(rs.AddLine(stpoint, endpoint))
        
        #calling function with different angle parameter for branch splitting
        fractal(depth - 1 , x2, y2, z2, length, (anglerec+angle+arn), angle, lvariation, aran, lran)
        fractal(depth - 1 , x2, y2, z2, length, (anglerec-angle+arn), angle, lvariation, aran, lran)
        
#first recursive function call
fractal(depth, x2, y2, z2, length, anglerec, angle, lvariation, aran, lran)
# ---------- end ghpython_script ----------
ghpython_script_2 = GhPythonScript(
    anchorp=construct_point_3,
    depth=depth_5,
    angle=max_angle_8,
    angleh=max_angle_9,
    length=starting_length_5,
    lvariation=length_change_5,
    aran=angle_randomness_5,
    lran=length_randomness_5,
    radtolen=radius_to_length_proportion_4)  # -> out, flatlinep; inputs anchorp: Point3d
# ---------- ghpython_script_2: Python ----------
#importing grasshopper python modules
import rhinoscriptsyntax as rs
import Rhino.Geometry as rg
import ghpythonlib.parallel as ghp
import ghpythonlib.components as ghc
import Rhino as rc


#importing generic modules
from math import cos
from math import sin
from math import radians
import random

#Inputs
#anchorp - point3D, anchor point
#depth - integer, recursion cnt
#angle - float, split base angle
#length - float, first branch length
#lvariation - float, length change with each branch
#aran - float, % of randomness in relation to base angle
#lran - float, % of randomness in relation to base length
#radtolen - proportion between starting length branch depth and branch radius

#getting starting point from anchorpoint
x1 = anchorp.X
y1 = anchorp.Y
z1 = anchorp.Z

#setting base variables
x2 = x1
y2 = y1
z2 = z1

#base angle
anglerec = 0
anglerech = 0

#list of lines that form the tree, this is the output variable 
treelin = {}

anglest = []

#recursive function
def fractal(depth, x2, y2, z2, length, anglerec, angle, lvariation, aran, lran, anglerech, angleh):
    
    #test if depth>0
    if depth:
        
        #defining random angle variation and length variation
        arn = random.uniform(-angle/100*aran, angle/100*aran)
        lrn = random.uniform(-length/100*lran, length/100*lran)
        
        #defining horizontal rotation angles
        ahor = random.sample(range(0,360), 4)
        
        #removing numbers within tolerance
        ahr = rs.CullDuplicateNumbers(ahor, angleh)
        
        #in a 360 fashion
        if ahr[0]+360-angleh<ahr[-1]:
            del ahr[0]
        
        #defining points
        x1 = x2
        y1 = y2
        z1 = z2 
        x2 = x1 - (length+lrn)*sin(radians(anglerec))*sin(radians(anglerech))
        y2 = y1 + (length+lrn)*sin(radians(anglerec))*cos(radians(anglerech))
        z2 = z1 + (length+lrn)*cos(radians(anglerec))
        
        #changing branch length dependant on branch depth
        length = length*lvariation
        
        #building points
        stpoint = rg.Point3d(x1, y1, z1)
        endpoint = rg.Point3d(x2, y2, z2)
        
        #building line between points
        linegeo = rg.Line(stpoint, endpoint)
        
        #building a dict of lines with depth as key, and corresponding lines as values
        if depth not in treelin.keys():
            treelin[depth] = [linegeo]
        else: 
            treelin[depth].append(linegeo)
        
        #calling function with different angle parameter for branch splitting
        #calling as many branches as spread within tolerance
        if len(ahr) > 0:
            fractal(depth - 1 , x2, y2, z2, length, (anglerec+angle+arn), angle, lvariation, aran, lran, ahr[0], angleh)
        if len(ahr) > 1:
            fractal(depth - 1 , x2, y2, z2, length, (anglerec-angle+arn), angle, lvariation, aran, lran, ahr[1], angleh)
        if len(ahr) > 2:
            fractal(depth - 1 , x2, y2, z2, length, (anglerec+angle+arn), angle, lvariation, aran, lran, ahr[2], angleh)
        if len(ahr) > 3:
            fractal(depth - 1 , x2, y2, z2, length, (anglerec-angle+arn), angle, lvariation, aran, lran, ahr[3], angleh)
        
#first recursive function call
fractal(depth, x2, y2, z2, length, anglerec, angle, lvariation, aran, lran, anglerech, angleh)

#sort dict of branch lines
treelinsorted = {}
branch = depth

for key in treelin.keys():
    treelinsorted[branch] = treelin[key]
    branch -= 1

#maybe implement intersect tests between branches
def removeintersections():
    pass
    #events = Rhino.Geometry.Intersect.Intersection.CurveCurve(curveA, curveB, intersection_tolerance, overlap_tolerance)

#function that create sphere capped pipes on lines
def pipes(args):
    crv, rad = args
    return ghc.Pipe(crv, rad, 1)

#paralle compute execution of pipes function
linep = []

for kk in treelinsorted.keys():
    args = [[treelinsorted[kk], (length*(lvariation**kk))/radtolen]]
    linep.append(ghp.run(pipes, args, True))

#flatten a list of pipes for output
flatlinep = [y for x in linep for y in x]
# ---------- end ghpython_script_2 ----------
ghpython_script_3 = GhPythonScript(
    anchorp=construct_point_4,
    depth=depth_6,
    angle=max_angle_10,
    angleh=max_angle_11,
    length=starting_length_6,
    lvariation=length_change_6,
    aran=angle_randomness_6,
    lran=length_randomness_6,
    radtolen=radius_to_length_proportion_5,
    mngon=starting_ngon_4)  # -> out, flatlinep, stpnt, endpnt, vect, pln, pgons, joined; inputs anchorp: Point3d
# ---------- ghpython_script_3: Python ----------
#importing grasshopper python modules
import rhinoscriptsyntax as rs
import Rhino.Geometry as rg
import ghpythonlib.parallel as ghp
import ghpythonlib.components as ghc
import Rhino as rc


#importing generic modules
from math import cos
from math import sin
from math import radians
import random

#Inputs
#anchorp - point3D, anchor point
#depth - integer, recursion cnt
#angle - float, split base angle
#length - float, first branch length
#lvariation - float, length change with each branch
#aran - float, % of randomness in relation to base angle
#lran - float, % of randomness in relation to base length
#radtolen - proportion between starting length branch depth and branch radius

#getting starting point from anchorpoint
x1 = anchorp.X
y1 = anchorp.Y
z1 = anchorp.Z

#setting base variables
x2 = x1
y2 = y1
z2 = z1

#base angle
anglerec = 0
anglerech = 0

#list of lines that form the tree, this is the output variable 
treelin = {}

anglest = []

#recursive function
def fractal(depth, x2, y2, z2, length, anglerec, angle, lvariation, aran, lran, anglerech, angleh):
    
    #test if depth>0
    if depth:
        
        #defining random angle variation and length variation
        arn = random.uniform(-angle/100*aran, angle/100*aran)
        lrn = random.uniform(-length/100*lran, length/100*lran)
        
        #defining horizontal rotation angles
        ahor = random.sample(range(0,360), 4)
        
        #removing numbers within tolerance
        ahr = rs.CullDuplicateNumbers(ahor, angleh)
        
        #in a 360 fashion
        if ahr[0]+360-angleh<ahr[-1]:
            del ahr[0]
        
        #defining points
        x1 = x2
        y1 = y2
        z1 = z2 
        x2 = x1 - (length+lrn)*sin(radians(anglerec))*sin(radians(anglerech))
        y2 = y1 + (length+lrn)*sin(radians(anglerec))*cos(radians(anglerech))
        z2 = z1 + (length+lrn)*cos(radians(anglerec))
        
        #changing branch length dependant on branch depth
        length = length*lvariation
        
        #building points
        stpoint = rg.Point3d(x1, y1, z1)
        endpoint = rg.Point3d(x2, y2, z2)
        
        #building line between points
        linegeo = rg.Line(stpoint, endpoint)
        
        #building a dict of lines with depth as key, and corresponding lines as values
        if depth not in treelin.keys():
            treelin[depth] = [linegeo]
        else: 
            treelin[depth].append(linegeo)
        
        #calling function with different angle parameter for branch splitting
        #calling as many branches as spread within tolerance
        if len(ahr) > 0:
            fractal(depth - 1 , x2, y2, z2, length, (anglerec+angle+arn), angle, lvariation, aran, lran, ahr[0], angleh)
        if len(ahr) > 1:
            fractal(depth - 1 , x2, y2, z2, length, (anglerec-angle+arn), angle, lvariation, aran, lran, ahr[1], angleh)
        if len(ahr) > 2:
            fractal(depth - 1 , x2, y2, z2, length, (anglerec+angle+arn), angle, lvariation, aran, lran, ahr[2], angleh)
        if len(ahr) > 3:
            fractal(depth - 1 , x2, y2, z2, length, (anglerec-angle+arn), angle, lvariation, aran, lran, ahr[3], angleh)
        
#first recursive function call
fractal(depth, x2, y2, z2, length, anglerec, angle, lvariation, aran, lran, anglerech, angleh)

#sort dict of branch lines
treelinsorted = {}
branch = depth

for key in treelin.keys():
    treelinsorted[branch] = treelin[key]
    branch -= 1

#maybe implement intersect tests between branches
def removeintersections():
    pass
    #events = Rhino.Geometry.Intersect.Intersection.CurveCurve(curveA, curveB, intersection_tolerance, overlap_tolerance)

#output list
pgons = []

#create ngon branch depth dependant
def ngons(args):
    nn, length, lvariation, kk, radtolen, mngon, depth = args
    stpnt = ghc.EndPoints(nn)[0] #returns list of two points, start and end
    endpnt = ghc.EndPoints(nn)[1]
    vect = ghc.Vector2Pt(stpnt, endpnt, False)[0] #returns list with vector and vector length
    pln = ghc.PlaneNormal(stpnt, vect) #returns a plane perp to a vector
    radius = length*(lvariation**kk)/radtolen
        
    #reduce details with each branch, but not less than 3
    if mngon-kk+1 <= 3:
        splits = 3
    else:
        splits = mngon-kk+1
    
    pgn = ghc.Polygon(pln, radius, splits, 0)[0] #returns a polygon and its perimeter
    
    if kk == depth and splits == 3:
        geo = ghc.ExtrudePoint(pgn, endpnt) #if last branch than make a pyramid
    else:
        geo = ghc.Extrude(pgn, vect) #extrudes the polygon along vector
    
    return ghc.CapHoles(geo) #caps ends on the extruded brep

#iterate over branches and run ngons func
for kk in treelinsorted.keys():
    for nn in treelinsorted[kk]:
        args = [nn, length, lvariation, kk, radtolen, mngon, depth]
        pgons.append(ngons(args))

def joiner(breps):
    return ghc.SolidUnion(breps)

#joined = joiner(pgons)
# ---------- end ghpython_script_3 ----------
ghpython_script_4 = GhPythonScript(
    anchorp=construct_point_5,
    depth=Slider(4, range=0..10),
    branches=max_horizontal_branches_4,
    angle=max_angle_12,
    angleh=max_angle_13,
    length=starting_length_7,
    lvariation=length_change_7,
    aran=angle_randomness_7,
    lran=length_randomness_7,
    radtolen=radius_to_length_proportion_6,
    mngon=starting_ngon_5)  # -> out, flatlinep, stpnt, endpnt, vect, pln, treelinout, pgons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; inputs anchorp: Point3d, branches: Int32
# ---------- ghpython_script_4: Python ----------
#importing grasshopper python modules
import rhinoscriptsyntax as rs
import Rhino.Geometry as rg
import ghpythonlib.parallel as ghp
import ghpythonlib.components as ghc
import Rhino as rc


#importing generic modules
from math import cos
from math import sin
from math import radians
import random

#Inputs
#anchorp - point3D, anchor point
#depth - integer, recursion cnt
#angle - float, split base angle
#length - float, first branch length
#lvariation - float, length change with each branch
#aran - float, % of randomness in relation to base angle
#lran - float, % of randomness in relation to base length
#radtolen - proportion between starting length branch depth and branch radius

#getting starting point from anchorpoint
x1 = anchorp.X
y1 = anchorp.Y
z1 = anchorp.Z-length #to generate starting vector

#setting base variables
x2 = x1
y2 = y1 
z2 = 0 #to generate starting vector

#base angle
anglerec = 0
anglerech = 0

#list of lines that form the tree, this is the output variable 
treelin = {}
anglest = []

#recursive function
def fractal(depth, x1, y1, z1, x2, y2, z2, length, anglerec, angle, lvariation, aran, lran, anglerech, angleh, branches):
    
    #test if depth>0
    if depth:
        
        #defining random angle variation and length variation
        arn = random.uniform(-angle/100*aran, angle/100*aran)
        lrn = random.uniform(-length/100*lran, length/100*lran)
        
        #defining horizontal rotation angles
        ahor = random.sample(range(0,360), branches)
        
        #removing numbers within tolerance
        ahr = rs.CullDuplicateNumbers(ahor, angleh)
        
        #in a 360 fashion
        if ahr[0]+360-angleh<ahr[-1]:
            del ahr[0]
            
        random.shuffle(ahr)
        
        #previous branch vector
        
        vecst = rg.Point3d(x1, y1, z1)
        vecend = rg.Point3d(x2, y2, z2)
        
        movevec = ghc.Vector2Pt(vecst, vecend, True)[0] #returns vector and it's length
        
        #perpendicular vector rotation plane
        
        rotplane3 = ghc.PlaneNormal(vecend, movevec) #creates plane perpendicular to vector
        plns = ghc.DeconstructPlane(rotplane3) #origin, x, y, z
        rotplane = ghc.ConstructPlane(plns[0], plns[3], plns[2]) #constructing new plane switching x and y planes to make perpendicular
        
        #generating perpendicular vector
        vecperp = ghc.Rotate(movevec, radians(90), rotplane)[0]
        
        #generating vector amplitudes
        leny = (length+lrn)*sin(radians(anglerec+arn))
        lenz = (length+lrn)*cos(radians(anglerec+arn))
        ampy = ghc.Amplitude(vecperp, leny)
        ampz = ghc.Amplitude(movevec, lenz)
        
        #changing branch length dependant on branch depth
        length = length*lvariation
        
        #building points
        endpoint1 = ghc.Move(vecend, ampz)[0] #returns moved object and transformation data
        endpoint = ghc.Move(endpoint1, ampy)[0] #returns moved object and transformation data
        
        #rotating point in a cone fashion
        rotpoint = ghc.Rotate3D(endpoint, anglerech, vecend, movevec)[0] #returns rotated geometry and transformation data
        
        #building line between points
        linegeo = rg.Line(vecend, rotpoint)
        
        #setting coords for next branch
        x1 = x2
        y1 = y2
        z1 = z2
        
        #getting xyz from rotated point
        x2 = rg.Point3d(rotpoint)[0]
        y2 = rg.Point3d(rotpoint)[1]
        z2 = rg.Point3d(rotpoint)[2]
        
        #building a dict of lines with depth as key, and corresponding lines as values
        if depth not in treelin.keys():
            treelin[depth] = [linegeo]
        else: 
            treelin[depth].append(linegeo)
        
        #calling function with different angle parameter for branch splitting
        #calling as many branches as spread within tolerance
        for aa in ahr:
            fractal(depth - 1 , x1, y1, z1, x2, y2, z2, length, angle, angle, lvariation, aran, lran, aa, angleh, branches)
        

        
#first recursive function call
fractal(depth, x1, y1, z1, x2, y2, z2, length, anglerec, angle, lvariation, aran, lran, anglerech, angleh, branches)

#sort dict of branch lines
treelinsorted = {}
branch = depth

for key in treelin.keys():
    treelinsorted[branch] = treelin[key]
    branch -= 1

#maybe implement intersect tests between branches
def removeintersections():
    pass
    #events = Rhino.Geometry.Intersect.Intersection.CurveCurve(curveA, curveB, intersection_tolerance, overlap_tolerance)

#output list
pgons = []

#create ngon branch depth dependant
def ngons(args):
    
    nn, length, lvariation, kk, radtolen, mngon, depth = args
    
    stpnt = ghc.EndPoints(nn)[0] #returns list of two points, start and end
    endpnt = ghc.EndPoints(nn)[1]
    vect = ghc.Vector2Pt(stpnt, endpnt, False)[0] #returns list with vector and vector length
    pln = ghc.PlaneNormal(stpnt, vect) #returns a plane perp to a vector
    radius = length*(lvariation**kk)/radtolen
        
    #reduce details with each branch, but not less than 3
    if mngon-kk+1 <= 3:
        splits = 3
    else:
        splits = mngon-kk+1
    
    pgn = ghc.Polygon(pln, radius, splits, 0)[0] #returns a polygon and its perimeter
    
    if kk == depth and splits == 3:
        geo = ghc.ExtrudePoint(pgn, endpnt) #if last branch than make a pyramid
    else:
        geo = ghc.Extrude(pgn, vect) #extrudes the polygon along vector
    
    return ghc.CapHoles(geo) #caps ends on the extruded brep

#iterate over branches and run ngons func
for kk in treelinsorted.keys():
    for nn in treelinsorted[kk]:
        args = [nn, length, lvariation, kk, radtolen, mngon, depth]
        pgons.append(ngons(args))

def joiner(breps):
    return ghc.SolidUnion(breps)

#joined = joiner(pgons)
# ---------- end ghpython_script_4 ----------
loft_options = LoftOptions(Closed=False, Adjust=True, Rebuild=0, Refit=0, Type=0)
ghpython_script_5 = GhPythonScript(
    anchorp=construct_point,
    depthstart=depth,
    branches=max_horizontal_branches,
    angle=max_angle,
    angleh=max_angle_2,
    length=starting_length,
    lvariation=length_change,
    aran=angle_randomness,
    lran=length_randomness,
    hrandom=Toggle(False),
    radtolen=radius_to_length_proportion,
    radchng=thicknress_change,
    mngon=starting_ngon,
    verticality=verticality,
    gchance=growth_chance)  # -> out, flatlinep, stpnt, endpnt, vect, pln, treelinout, pgons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; inputs anchorp: Point3d, branches: Int32, hrandom: Boolean
# ---------- ghpython_script_5: Python ----------
#importing grasshopper python modules
import rhinoscriptsyntax as rs
import Rhino.Geometry as rg
import ghpythonlib.parallel as ghp
import ghpythonlib.components as ghc
import Rhino as rc


#importing generic modules
from math import cos
from math import sin
from math import radians
import random
from math import degrees

#Inputs
#anchorp - point3D, anchor point
#depth - integer, recursion cnt
#angle - float, split base angle
#length - float, first branch length
#lvariation - float, length change with each branch
#aran - float, % of randomness in relation to base angle
#lran - float, % of randomness in relation to base length
#radtolen - proportion between starting length branch depth and branch radius

#angle = angle*2

#getting starting point from anchorpoint
x1 = anchorp.X
y1 = anchorp.Y
z1 = anchorp.Z-length #to generate starting vector

#setting base variables
x2 = x1
y2 = y1 
z2 = anchorp.Z #to generate starting vector

#base angle
anglerec = 0
anglerech = 0

#list of lines that form the tree, this is the output variable 
treelin = {}

verticality /= 100
gchance /= 100

depth = depthstart

#recursive function
def fractal(depth, x1, y1, z1, x2, y2, z2, length, anglerec, angle, lvariation, aran, lran, anglerech, angleh, branches, verticality, gchance):
    
    #test if depth>0
    if depth:
        
        #defining random angle variation and length variation
        arn = random.uniform(-angle/100*aran, angle/100*aran)
        lrn = random.uniform(-length/100*lran, length/100*lran)
        
        if hrandom == True:
            #defining horizontal rotation angles
            ahor = random.sample(range(0,360), branches)
            
            #removing numbers within tolerance
            ahr = rs.CullDuplicateNumbers(ahor, angleh)
            
            #in a 360 fashion
            if ahr[0]+360-angleh<ahr[-1]:
                del ahr[0]
        else:
            #generating evenly distributed angles
            ahr = range(0, 360+1, 360//branches)[:-1]
        
        #previous branch vector
        vecst = rg.Point3d(x1, y1, z1)
        vecend = rg.Point3d(x2, y2, z2)
        movevec = ghc.Vector2Pt(vecst, vecend, True)[0] #returns vector and it's length
        
        #perpendicular vector 
        rotplane3 = ghc.PlaneNormal(vecend, movevec) #creates plane perpendicular to vector
        plns = ghc.DeconstructPlane(rotplane3) #origin, x, y, z
        rotplane = ghc.ConstructPlane(plns[2], plns[1], plns[3]) #constructing new plane switching x and y planes to make perpendicular
        
        #generating perpendicular vector
        vecperp = ghc.Rotate(movevec, radians(90), rotplane)[0]
        
        #generating vector amplitudes
        leny = (length+lrn)*sin(radians((anglerec+arn)*(1-(verticality**depth))))
        lenz = (length+lrn)*cos(radians(anglerec+arn))
        ampy = ghc.Amplitude(vecperp, leny)
        ampz = ghc.Amplitude(movevec, lenz)
        
        #changing branch length dependant on branch depth
        length = length*lvariation
        
        #building points
        endpoint1 = ghc.Move(vecend, ampz)[0] #returns moved object and transformation data
        endpoint = ghc.Move(endpoint1, ampy)[0] #returns moved object and transformation data
        
        #rotating point in a cone fashion
        rotpoint = ghc.Rotate3D(endpoint, radians(anglerech), vecend, movevec)[0] #returns rotated geometry and transformation data
        
        #building line between points
        linegeo = rg.Line(vecend, rotpoint)
        
        #setting coords for next branch
        x1 = x2
        y1 = y2
        z1 = z2
        
        #getting xyz from rotated point
        x2 = rg.Point3d(rotpoint)[0]
        y2 = rg.Point3d(rotpoint)[1]
        z2 = rg.Point3d(rotpoint)[2]
        
        #building a dict of lines with depth as key, and corresponding lines as values
        if depth not in treelin.keys():
            treelin[depth] = [linegeo]
        else: 
            treelin[depth].append(linegeo)
        
        #calling function with different angle parameter for branch splitting
        #calling as many branches as spread within tolerance
        
        for aa in ahr:
            if ((random.randint(40, 99)/100)**depth) < gchance or depth == depthstart+1: #or added to prevent blank trees
                fractal(depth - 1 , x1, y1, z1, x2, y2, z2, length, angle, angle, lvariation, aran, lran, aa, angleh, branches, verticality, gchance)

#first recursive function call
fractal(depth, x1, y1, z1, x2, y2, z2, length, anglerec, angle, lvariation, aran, lran, anglerech, angleh, branches, verticality, gchance)



#maybe implement intersect tests between branches
def removeintersections():
    pass
    #events = Rhino.Geometry.Intersect.Intersection.CurveCurve(curveA, curveB, intersection_tolerance, overlap_tolerance)

#output list
pgons = []

#make list of values
branch = depthstart
parallelinputs = []
for kk in treelin.keys():
    for nn in treelin[kk]:
        parallelinputs.append([branch, nn])
    branch -= 1

def makegeo(args):
    kk, nn = args
    stpnt = ghc.EndPoints(nn)[0] #returns list of two points, start and end
    endpnt = ghc.EndPoints(nn)[1]
    pln = ghc.PlaneNormal(stpnt, nn) #returns a plane perp to a vector
    radius = length*(radchng**kk)/radtolen
    radiusend = length*(radchng**(kk+1))/radtolen
    
    #reduce details with each branch, but not less than 3
    if mngon-kk+1 <= 3:
        splits = 3
    else:
        splits = mngon-kk+1
    
    pgn = ghc.Polygon(pln, radius, splits, 0)[0] #returns a polygon and its perimeter
    
    if kk == depth and splits == 3:
        geo = ghc.ExtrudePoint(pgn, endpnt) #if last branch than make a pyramid
    else:
        geostraight = ghc.Extrude(pgn, nn) #extrudes the polygon along vector
        geo = ghc.Taper(geostraight, nn, radius, radiusend, False, False, False) #inputs: geometry, axis, start radius, end radius, flat (False), infinite (False), rigid (False)
    
    geo3 = ghc.CapHoles(geo) #caps ends on the extruded brep
    pgons.append(geo3)


ghp.run(makegeo, parallelinputs, True)

def joiner(breps):
    return ghc.SolidUnion(breps)

#joined = ghp.run(joiner, [pgons], True)
# ---------- end ghpython_script_5 ----------
ghpython_script_6 = GhPythonScript(
    anchorp=construct_point_7,
    depthstart=depth_3,
    branches=max_horizontal_branches_2,
    angle=max_angle_3,
    angleh=max_angle_5,
    length=starting_length_2,
    lvariation=length_change_2,
    aran=angle_randomness_2,
    lran=length_randomness_2,
    hrandom=Toggle(False),
    radtolen=radius_to_length_proportion_2,
    radchng=thicknress_change_2,
    mngon=starting_ngon_2,
    verticality=verticality_2,
    gchance=growth_chance_2)  # -> out, flatlinep, stpnt, endpnt, vect, pln, treelinout, pgons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; inputs anchorp: Point3d, branches: Int32, hrandom: Boolean
# ---------- ghpython_script_6: Python ----------
#importing grasshopper python modules
import rhinoscriptsyntax as rs
import Rhino.Geometry as rg
import ghpythonlib.parallel as ghp
import ghpythonlib.components as ghc
import Rhino as rc


#importing generic modules
from math import cos
from math import sin
from math import radians
import random
from math import degrees

#Inputs
#anchorp - point3D, anchor point
#depth - integer, recursion cnt
#angle - float, split base angle
#length - float, first branch length
#lvariation - float, length change with each branch
#aran - float, % of randomness in relation to base angle
#lran - float, % of randomness in relation to base length
#radtolen - proportion between starting length branch depth and branch radius

#angle = angle*2

#getting starting point from anchorpoint
x1 = anchorp.X
y1 = anchorp.Y
z1 = anchorp.Z-length #to generate starting vector

#setting base variables
x2 = x1
y2 = y1 
z2 = anchorp.Z #to generate starting vector

#base angle
anglerec = 0
anglerech = 0

#list of lines that form the tree, this is the output variable 
treelin = {}

verticality /= 100
gchance /= 100

depth = depthstart

#recursive function
def fractal(depth, x1, y1, z1, x2, y2, z2, length, anglerec, angle, lvariation, aran, lran, anglerech, angleh, branches, verticality, gchance):
    
    #test if depth>0
    if depth:
        
        #defining random angle variation and length variation
        arn = random.uniform(-angle/100*aran, angle/100*aran)
        lrn = random.uniform(-length/100*lran, length/100*lran)
        
        if hrandom == True:
            #defining horizontal rotation angles
            ahor = random.sample(range(0,360), branches)
            
            #removing numbers within tolerance
            ahr = rs.CullDuplicateNumbers(ahor, angleh)
            
            #in a 360 fashion
            if ahr[0]+360-angleh<ahr[-1]:
                del ahr[0]
        else:
            #generating evenly distributed angles
            ahr = range(0, 360+1, 360//branches)[:-1]
        
        #previous branch vector
        vecst = rg.Point3d(x1, y1, z1)
        vecend = rg.Point3d(x2, y2, z2)
        movevec = ghc.Vector2Pt(vecst, vecend, True)[0] #returns vector and it's length
        
        #perpendicular vector 
        rotplane3 = ghc.PlaneNormal(vecend, movevec) #creates plane perpendicular to vector
        plns = ghc.DeconstructPlane(rotplane3) #origin, x, y, z
        rotplane = ghc.ConstructPlane(plns[2], plns[1], plns[3]) #constructing new plane switching x and y planes to make perpendicular
        
        #generating perpendicular vector
        vecperp = ghc.Rotate(movevec, radians(90), rotplane)[0]
        
        #generating vector amplitudes
        leny = (length+lrn)*sin(radians((anglerec+arn)*(1-(verticality**depth))))
        lenz = (length+lrn)*cos(radians(anglerec+arn))
        ampy = ghc.Amplitude(vecperp, leny)
        ampz = ghc.Amplitude(movevec, lenz)
        
        #changing branch length dependant on branch depth
        length = length*lvariation
        
        #building points
        endpoint1 = ghc.Move(vecend, ampz)[0] #returns moved object and transformation data
        endpoint = ghc.Move(endpoint1, ampy)[0] #returns moved object and transformation data
        
        #rotating point in a cone fashion
        rotpoint = ghc.Rotate3D(endpoint, radians(anglerech), vecend, movevec)[0] #returns rotated geometry and transformation data
        
        #building line between points
        linegeo = rg.Line(vecend, rotpoint)
        
        #setting coords for next branch
        x1 = x2
        y1 = y2
        z1 = z2
        
        #getting xyz from rotated point
        x2 = rg.Point3d(rotpoint)[0]
        y2 = rg.Point3d(rotpoint)[1]
        z2 = rg.Point3d(rotpoint)[2]
        
        #building a dict of lines with depth as key, and corresponding lines as values
        if depth not in treelin.keys():
            treelin[depth] = [linegeo]
        else: 
            treelin[depth].append(linegeo)
        
        #calling function with different angle parameter for branch splitting
        #calling as many branches as spread within tolerance
        
        for aa in ahr:
            if ((random.randint(40, 99)/100)**depth) < gchance or depth == depthstart+1: #or added to prevent blank trees
                fractal(depth - 1 , x1, y1, z1, x2, y2, z2, length, angle, angle, lvariation, aran, lran, aa, angleh, branches, verticality, gchance)

#first recursive function call
fractal(depth, x1, y1, z1, x2, y2, z2, length, anglerec, angle, lvariation, aran, lran, anglerech, angleh, branches, verticality, gchance)

#sort dict of branch lines
treelinsorted = {}
branch = depth

for key in treelin.keys():
    treelinsorted[branch] = treelin[key]
    branch -= 1

#maybe implement intersect tests between branches
def removeintersections():
    pass
    #events = Rhino.Geometry.Intersect.Intersection.CurveCurve(curveA, curveB, intersection_tolerance, overlap_tolerance)

#output list
pgons = []

#create ngon branch depth dependant
def ngons(args):
    
    nn, length, lvariation, kk, radtolen, mngon, depth, radchng = args
    
    stpnt = ghc.EndPoints(nn)[0] #returns list of two points, start and end
    endpnt = ghc.EndPoints(nn)[1]
    pln = ghc.PlaneNormal(stpnt, nn) #returns a plane perp to a vector
    radius = length*(radchng**kk)/radtolen
    radiusend = length*(radchng**(kk+1))/radtolen
        
    #reduce details with each branch, but not less than 3
    if mngon-kk+1 <= 3:
        splits = 3
    else:
        splits = mngon-kk+1
    
    pgn = ghc.Polygon(pln, radius, splits, 0)[0] #returns a polygon and its perimeter
    
    if kk == depth and splits == 3:
        geo = ghc.ExtrudePoint(pgn, endpnt) #if last branch than make a pyramid
    else:
        geostraight = ghc.Extrude(pgn, nn) #extrudes the polygon along vector
        geo = ghc.Taper(geostraight, nn, radius, radiusend, False, False, False) #inputs: geometry, axis, start radius, end radius, flat (False), infinite (False), rigid (False)
        
    return ghc.CapHoles(geo) #caps ends on the extruded brep

#iterate over branches and run ngons func
def makegeo(treelinsorted):
    for kk in treelinsorted.keys():
        for nn in treelinsorted[kk]:
            args = [nn, length, lvariation, kk, radtolen, mngon, depth, radchng]
            pgons.append(ngons(args))
            
ghp.run(makegeo, [treelinsorted], True)

def joiner(breps):
    return ghc.SolidUnion(breps)

#joined = joiner(pgons)
# ---------- end ghpython_script_6 ----------
ghpython_script_7 = GhPythonScript(
    anchorp=construct_point_2,
    depthstart=depth_2,
    branches=max_horizontal_branches_3,
    angle=max_angle_4,
    angleh=max_angle_6,
    length=starting_length_3,
    lvariation=length_change_3,
    aran=angle_randomness_3,
    lran=length_randomness_3,
    hrandom=Toggle(True),
    radtolen=radius_to_length_proportion_3,
    radchng=thicknress_change_3,
    mngon=starting_ngon_3,
    verticality=verticality_3,
    gchance=growth_chance_3,
    leaflen=Slider(75, range=0..100),
    leafwidth=Slider(22, range=0..100),
    maxleaves=Slider(2, range=0..5))  # -> out, pgnosout, testpoint; inputs anchorp: Point3d, branches: Int32, hrandom: Boolean
# ---------- ghpython_script_7: Python ----------
#importing grasshopper python modules
import rhinoscriptsyntax as rs
import Rhino.Geometry as rg
import ghpythonlib.parallel as ghp
import ghpythonlib.components as ghc
import Rhino as rc
import Rhino
import Rhino.Commands as rcc
import Grasshopper.Kernel as ghk

#importing generic modules
from math import cos
from math import sin
from math import radians
import random
from math import degrees

#Inputs
#anchorp - point3D, anchor point
#depth - integer, recursion cnt
#angle - float, split base angle
#length - float, first branch length
#lvariation - float, length change with each branch
#aran - float, % of randomness in relation to base angle
#lran - float, % of randomness in relation to base length
#radtolen - proportion between starting length branch depth and branch radius

#angle = angle*2

#getting starting point from anchorpoint
x1 = anchorp.X
y1 = anchorp.Y
z1 = anchorp.Z-length #to generate starting vector

#setting base variables
x2 = x1
y2 = y1 
z2 = anchorp.Z #to generate starting vector

#setting first polygon
radiusbase = length/radtolen
stpntbase = rg.Point3d(x1, y1, z1)
stpntbaseend = rg.Point3d(x2, y2, z2)
vecbase = rg.Line(stpntbase, stpntbaseend)
plnbase = ghc.PlaneNormal(stpntbaseend, vecbase) #returns a plane perp to a vector
polygonbase = ghc.Polygon(plnbase, radiusbase, mngon, 0)[0] #returns a polygon and its perimeter

#base angle
anglerec = 0
anglerech = 0
cluster = [1]
branch_cluster = cluster[0]

verticality /= 100
gchance /= 100
mngon -= 1 #first mngon is defined outside recursive func, so it should enter it with -1

depth = depthstart

#output list
pgons = {}
pgnosout = [] #for debug purposes
testpoint = []

#recursive function
def fractal(depth, x1, y1, z1, x2, y2, z2, length, anglerec, angle, lvariation, aran, lran, anglerech, angleh, branches, verticality, gchance, depthstart, radtolen, radchng, mngon, polygon, branch_cluster):
    
    #test if depth>0
    if depth:
        
        #defining random angle variation and length variation
        arn = random.uniform(-angle/100*aran, angle/100*aran)
        lrn = random.uniform(-length/100*lran, length/100*lran)
        
        if hrandom == True:
            #defining horizontal rotation angles
            ahor = random.sample(range(0,360), branches)
            
            #removing numbers within tolerance
            ahr = rs.CullDuplicateNumbers(ahor, angleh)
            
            #in a 360 fashion
            if ahr[0]+360-angleh<ahr[-1]:
                del ahr[0]
        else:
            #generating evenly distributed angles
            ahr = range(0, 360+1, 360//branches)[:-1]
        
        #previous branch vector
        vecst = rg.Point3d(x1, y1, z1)
        vecend = rg.Point3d(x2, y2, z2)
        movevec = ghc.Vector2Pt(vecst, vecend, True)[0] #returns vector and it's length
        
        #perpendicular vector 
        rotplane3 = ghc.PlaneNormal(vecend, movevec) #creates plane perpendicular to vector
        plns = ghc.DeconstructPlane(rotplane3) #origin, x, y, z
        rotplane = ghc.ConstructPlane(plns[2], plns[1], plns[3]) #constructing new plane switching x and y planes to make perpendicular
        
        #generating perpendicular vector
        vecperp = ghc.Rotate(movevec, radians(90), rotplane)[0]
        
        #generating vector amplitudes
        leny = (length+lrn)*sin(radians((anglerec+arn)*(1-(verticality**depth))))
        lenz = (length+lrn)*cos(radians(anglerec+arn))
        ampy = ghc.Amplitude(vecperp, leny)
        ampz = ghc.Amplitude(movevec, lenz)
        
        #changing branch length dependant on branch depth
        length = length*lvariation
        
        #building points
        endpoint1 = ghc.Move(vecend, ampz)[0] #returns moved object and transformation data
        endpoint = ghc.Move(endpoint1, ampy)[0] #returns moved object and transformation data
        
        #rotating point in a cone fashion
        rotpoint = ghc.Rotate3D(endpoint, radians(anglerech), vecend, movevec)[0] #returns rotated geometry and transformation data
        
        #building line between points
        linegeo = rg.Line(vecend, rotpoint)
        
        #defining recursion depth
        key = depthstart+1-depth
        
        #building geometry
        pln = ghc.PlaneNormal(rotpoint, linegeo) #returns a plane perp to a vector
        radius = length*(radchng**(key))/radtolen
        
        #reduce details with each branch, but not less than 3
        if mngon-key+1 <= 3:
            splits = 3
        else:
            splits = mngon-key+1
            
        polygonend = ghc.Polygon(pln, radius, splits, 0)[0] #returns a polygon and its perimeter
        
        #aligning curves for loft creation
        crvst = ghc.EndPoints(polygon)[0]
        pntcld = ghc.Discontinuity(polygonend, 1) #returns points and point parameters
        
        #finind seam point
        closest_point = ghc.ClosestPoint(crvst, pntcld[0]) #returns closest point, closest point index, distance between closest points
        seampnt = pntcld[1][closest_point[1]]
        polygonend = ghc.Seam(polygonend, seampnt)
        
        lcurves = [polygon, polygonend]
        
        #building geometry
        if depth == 1 and splits == 3:
            geo = ghc.ExtrudePoint(polygon, rotpoint) #if last branch than make a pyramid
        else:
            geo = rg.Brep.CreateFromLoft(lcurves, rg.Point3d.Unset, rg.Point3d.Unset, rg.LoftType.Normal, False)[0]
        
        #make solid
        geocapped = ghc.CapHoles(geo)
        #geocapped = ghc.CapHolesEx(geo)[0] #for testing purposes
        
        #building a dict of geo with depth as key, and geo as values, for more efficient joins
        
        if branch_cluster not in pgons.keys():
            pgons[branch_cluster] = [geocapped]
        else: 
            pgons[branch_cluster].append(geocapped)
        
        pgnosout.append(geocapped)
        
        #setting coords for next branch
        x1 = x2
        y1 = y2
        z1 = z2
        
        #getting xyz from rotated point
        x2 = rg.Point3d(rotpoint)[0]
        y2 = rg.Point3d(rotpoint)[1]
        z2 = rg.Point3d(rotpoint)[2]
        
        #setting base polygon for next branch
        polygon = polygonend
        
        #calling function with different angle parameter for branch splitting
        #calling as many branches as spread within tolerance
        #filling dict with branch clusters
        cluster.append(cluster[-1]+1)
        branch_cluster=cluster[-1]
        
        if depth != 1:
            for aa in ahr:
                if ((random.randint(40, 99)/100)**depth) < gchance or depth == depthstart+1: #or added to prevent blank trees
                    fractal(depth - 1 , x1, y1, z1, x2, y2, z2, length, angle, angle, lvariation, aran, lran, aa, angleh, branches, verticality, gchance, depthstart, radtolen, radchng, mngon, polygon, branch_cluster)
        else:
            pass
            
            #leaf logic
            #vector for leaf growth spread
            leafpntvec = ghc.Vector2Pt(vecend, rotpoint, True)[0]
            
            #setting leaf growth position on last barnch
            lenleaf = (length+lrn)*cos(radians(anglerec+arn))/3*2
            lenleaf = random.uniform(lenleaf/5*4, lenleaf/5*6)
            lenleaf2 = (length+lrn)*cos(radians(anglerec+arn))/3
            lenleaf2 = random.uniform(lenleaf2/5*4, lenleaf2/5*6)
            lenleaf3 = (length+lrn)*cos(radians(anglerec+arn))
            lenleaf3 = random.uniform(lenleaf3/5*4, lenleaf3/5*6)
            
            ampleaf1 = ghc.Amplitude(leafpntvec, lenleaf)
            ampleaf2 = ghc.Amplitude(leafpntvec, lenleaf2)
            ampleaf3 = ghc.Amplitude(leafpntvec, lenleaf3)
            
            #setting leaf gworth points
            leafpoint1 = ghc.Move(vecend, ampleaf1)[0]
            leafpoint2 = ghc.Move(vecend, ampleaf2)[0]
            leafpoint3 = ghc.Move(vecend, ampleaf3)[0]
            
            #creating a points list to iterate over
            leafbasepnt = [leafpoint1, leafpoint2, leafpoint3, rotpoint]
            
            for leaf in leafbasepnt:
                #create an imaginary circle with leaflen radius and populate it with points for random leaf generation
                testcircle = ghc.Circle(leaf, leaflen)
                circlesurf = ghc.BoundarySurfaces(testcircle)
                leafendpnts = ghc.PopulateGeometry(circlesurf, random.randint(2, maxleaves+1), random.randint(1,500)) #has to be over 1 for correct iteration, else iterates over xyz values
                
                #iterate over random number of generated points
                for pp in leafendpnts:
                    #random z move
                    zmove = rg.Vector3d(0, 0, 1)
                    moveamp = random.uniform(-leaflen/3, 0)
                    ampzmove = ghc.Amplitude(zmove, moveamp)
                    llendpnt = ghc.Move(pp, ampzmove)[0]
                    
                    #setting a leaf centerline vector
                    leafvector = ghc.Vector2Pt(leaf, llendpnt, True)[0]
                    #defining leaf center point as avarage of st and end pnts
                    midpnt = ghc.Average([leaf, llendpnt])
                    
                    #creating a xy vector perpendicular to leaf axis
                    leafmoveperp = ghc.PlaneNormal(midpnt, leafvector)
                    plnsdec = ghc.DeconstructPlane(leafmoveperp) #origin, x, y, z
                    rotplaneleaf = ghc.ConstructPlane(plnsdec[2], plnsdec[1], plnsdec[3]) #constructing new plane switching x and y planes to make perpendicular
                    
                    #generating perpendicular vector
                    vecperpleaf = ghc.Rotate(leafvector, radians(90), rotplaneleaf)[0]
                    leafperpamp = ghc.Amplitude(vecperpleaf, random.uniform((leafwidth/2)/5*4, (leafwidth/2)/5*6))
                    
                    #moving mid point to both sides
                    midpnt1 = ghc.Move(midpnt, leafperpamp)[0]
                    midpnt2 = ghc.Move(midpnt, -leafperpamp)[0]
                    
                    #leaf geo
                    leafgeo = rg.NurbsSurface.CreateFromCorners(leaf, midpnt1, llendpnt, midpnt2)
                    
                    testpoint.append(leafgeo)
            


#first recursive function call
fractal(depth, x1, y1, z1, x2, y2, z2, length, anglerec, angle, lvariation, aran, lran, anglerech, angleh, branches, verticality, gchance, depthstart, radtolen, radchng, mngon, polygonbase, branch_cluster)

"""
#CAN THROW ERRORS BECAUSE OF BOOLEAN UNION LOGIC 
data_for_parallel = []
data_single = []
for key in pgons.keys():
    if len(pgons[key]) != 1:
        branch_geo = []
        for nn in pgons[key]:
            branch_geo.append(nn)
        data_for_parallel.append(branch_geo)
    else:
        data_single.append(pgons[key][0])


def joiner(breps):
    try:
        union = ghc.SolidUnion(breps)
    except:
        return breps
    else:
        return union 
joined = []

for data in data_for_parallel:
    joined.append(joiner(data))
#joined = ghp.run(joiner, data_for_parallel, True)
#treeoutput = [joined, data_single]


#print(cluster)
#print(pgons)
#print(data_for_parallel)
"""
# ---------- end ghpython_script_7 ----------
loft_options_2 = LoftOptions(Closed=False, Adjust=False, Rebuild=0, Refit=0, Type=0)
ghpython_script_8 = GhPythonScript(x=loft_options)  # -> out, a
# ---------- ghpython_script_8: Python ----------
import rhinoscriptsyntax as rs
import Rhino.Geometry as rg
import ghpythonlib.componentbase as ghcp
import ghpythonlib.components as ghc

print x

print ghc.LoftOptions(True, True, 0, 0, 0)
# ---------- end ghpython_script_8 ----------
panel = Panel(ghpython_script_3.out)
panel_2 = Panel(ghpython_script_7.out)
# work good
weaverbird_s_laplacianhc_smoothing = WeaverbirdsLaplacianHCSmoothing(Level=1, SmoothNakedEdges=1, PartialOriginal=0, Orientation=0, VolumeSavingActivation=1, Thin=1)
weaverbird_s_laplacian_smoothing = WeaverbirdsLaplacianSmoothing(Level=1, SmoothNakedEdges=1, Thin=1)
weaverbird_s_loop_subdivision = WeaverbirdsLoopSubdivision(Level=Slider(1, range=0..10), SmoothNakedEdges=1)
